# Grasshopper definition parametric_arrows.gh (Grasshopper 1.0.7)
# plug-ins: ClipperComponents

cell_size = Slider(15, range=5..30)
x_cells = Slider(4, range=0..30)
y_cells = Slider(14, range=0..30)
multiplication = Multiplication(A=cell_size, B=x_cells)
multiplication_2 = Multiplication(A=cell_size, B=y_cells)
plane_surface = PlaneSurface(Plane=PlaneXY(0, 0, 0), XSize=multiplication, YSize=multiplication_2)
divide_domain² = DivideDomain²(Domain=plane_surface, UCount=x_cells, VCount=y_cells)
isotrim = Isotrim(Surface=plane_surface, Domain=divide_domain²)
deconstruct_brep = DeconstructBrep(Brep=isotrim)  # -> Faces, Edges, Vertices
arrow_extension = Slider(0.734, range=0..1)
dom = ConstructDomain(DomainStart=0, DomainEnd=1)
sift = SiftPattern(List=deconstruct_brep.Edges, SiftPattern=[0, 1])  # -> Output0, Output1
area = Area(Geometry=deconstruct_brep.Faces)  # -> Area, Centroid
deconstruct = Deconstruct(Point=area.Centroid)  # -> flatten(XComponent), flatten(YComponent), ZComponent
bounds = Bounds(Numbers=deconstruct.YComponent)
bounds_2 = Bounds(Numbers=deconstruct.XComponent)
remap_numbers = RemapNumbers(Value=deconstruct.YComponent, Source=bounds, Target=dom)  # -> Mapped, Clipped
point_on_curve = PointOnCurve(sift.Output0, parameter=0.5)
remap_numbers_2 = RemapNumbers(Value=deconstruct.XComponent, Source=bounds_2, Target=dom)  # -> Mapped, Clipped
cull = CullPattern(List=deconstruct_brep.Vertices, CullPattern=[True, True, False, False])
construct_domain = ConstructDomain(DomainStart=Slider(0.2, range=0..10), DomainEnd=Slider(0.8, range=0..1))
expression = Expression(x=remap_numbers_2.Clipped, y=remap_numbers.Clipped, Expression="abs(sin(2*π*y))")
bounds_3 = Bounds(Numbers=expression)
num = Number(0.4)
pline = PolyLine(Vertices=point_on_curve, Closed=False)
num_2 = Number(0.4001)
dom_2 = ConstructDomain(DomainStart=num, DomainEnd=num_2)
remap_numbers_3 = RemapNumbers(Value=expression, Source=bounds_3, Target=construct_domain)  # -> Mapped, Clipped
len = Length(Curve=pline)
end = EndPoints(Curve=pline)  # -> Start, End
shift = ShiftList(List=remap_numbers_3.Clipped, Shift=1, Wrap=True)  # -> graft(List)
multiplication_3 = Multiplication(A=len, B=graft(shift))
eval = EvaluateCurve(Curve=reparameterize(pline), Parameter=graft(remap_numbers_3.Clipped))  # -> Point, Tangent, Angle
ext = ExtendCurve(Curve=pline, Type=0, Start=multiplication_3, End=multiplication_3)
end_2 = EndPoints(Curve=ext)  # -> Start, End
pt = Point(end_2.End)
weave = Weave(Pattern=[0, 1, 2, 1], Stream0=pt, Stream1=cull, Stream2=eval.Point, NullGaps=False)
pline_2 = PolyLine(Vertices=weave, Closed=True)  # -> flatten(Polyline)
polyline_offset = PolylineOffset(
    Polylines=flatten(pline_2),
    Distance=Slider(0.23, range=0..1),
    Plane=Plane(origin=(0, 0, 0), x=(0, 0, 0), y=(0, 0, 0)),
    Tolerance=0.001,
    ClosedFillet=2,
    OpenFillet=0,
    Miter=2)  # -> flatten(Contour), Holes
group = Group(Objects=pline_2)
bbox = BoundingBox(Content=simplify(flatten(group)), Plane=PlaneXY(0, 0, 0))  # -> Box, Box_2
num_3 = Number(8)
box_corners = BoxCorners(Box=bbox.Box)  # -> CornerA, CornerB, CornerC, CornerD, CornerE, CornerF, CornerG, CornerH
moveaway = MoveAwayFrom(Geometry=box_corners.CornerA, Emitter=box_corners.CornerD, Distance=num_3)  # -> Geometry, Transform
moveaway_2 = MoveAwayFrom(Geometry=box_corners.CornerC, Emitter=box_corners.CornerF, Distance=num_3)  # -> Geometry, Transform
num_4 = Number(15)
rec_3pt = Rectangle3Pt(PointA=box_corners.CornerC, PointB=box_corners.CornerD, PointC=moveaway_2.Geometry)  # -> flatten(Rectangle), Length
rec_3pt_2 = Rectangle3Pt(PointA=box_corners.CornerA, PointB=box_corners.CornerB, PointC=moveaway.Geometry)  # -> flatten(Rectangle), Length
vector_xyz = VectorXYZ(XComponent=Slider(0, range=0..10), YComponent=Slider(0, range=0..10), ZComponent=Slider(5, range=0..10))  # -> Vector, Length
area_2 = Area(Geometry=rec_3pt_2.Rectangle)  # -> Area, Centroid
area_3 = Area(Geometry=rec_3pt.Rectangle)  # -> Area, Centroid
num_5 = Number(5)
moveaway_3 = MoveAwayFrom(Geometry=area_2.Centroid, Emitter=bbox.Box, Distance=num_4)  # -> Geometry, Transform
moveaway_4 = MoveAwayFrom(Geometry=area_3.Centroid, Emitter=bbox.Box, Distance=num_4)  # -> Geometry, Transform
ln = Line(StartPoint=area_2.Centroid, EndPoint=moveaway_3.Geometry)
ln_2 = Line(StartPoint=area_3.Centroid, EndPoint=moveaway_4.Geometry)
polyoffset = PolylineOffset(
    Polylines=ln_2,
    Distance=num_5,
    Plane=Plane(origin=(0, 0, 0), x=(0, 0, 0), y=(0, 0, 0)),
    Tolerance=0.001,
    ClosedFillet=0,
    OpenFillet=2,
    Miter=2)  # -> Contour, Holes
polyoffset_2 = PolylineOffset(
    Polylines=ln,
    Distance=num_5,
    Plane=Plane(origin=(0, 0, 0), x=(0, 0, 0), y=(0, 0, 0)),
    Tolerance=0.001,
    ClosedFillet=0,
    OpenFillet=2,
    Miter=2)  # -> Contour, Holes
runion = RegionUnion(Curves=flatten([polyoffset.Contour, rec_3pt.Rectangle]))
runion_2 = RegionUnion(Curves=flatten([polyoffset_2.Contour, rec_3pt_2.Rectangle]))
curve = Curve([polyline_offset.Contour, rec_3pt.Rectangle, rec_3pt_2.Rectangle, polyoffset_2.Contour, runion, runion_2])
runion_3 = RegionUnion(Curves=flatten(curve))
curvepoint = PointOnCurve(ln_2, parameter=0.667)
num_6 = Number(2)
curvepoint_2 = PointOnCurve(ln, parameter=0.667)
circle = CircleCNR(Center=curvepoint_2, Normal=Vector(0, 0, 1), Radius=num_6)
circle_2 = CircleCNR(Center=curvepoint, Normal=Vector(0, 0, 1), Radius=num_6)
crv = Curve([circle_2, circle, polyline_offset.Holes])
rdiff = RegionDifference(CurvesA=runion_3, CurvesB=crv)
boundary_surfaces = BoundarySurfaces(Edges=flatten(rdiff))
gate = StreamGate(Stream=boundary_surfaces, Gate=Toggle(True))  # -> Target0, Target1
extrude = Extrude(Base=flatten(gate.Target1), Direction=vector_xyz.Vector)
