# Grasshopper definition parametric_birkenstock_2.gh (Grasshopper 1.0.7)
# plug-ins: ClipperComponents

cell_size = Slider(15, range=5..30)
x_cells = Slider(12, range=0..30)
y_cells = Slider(13, range=1..31)
multiplication = Multiplication(A=cell_size, B=x_cells)
multiplication_2 = Multiplication(A=cell_size, B=y_cells)
dom = ConstructDomain(DomainStart=0, DomainEnd=1)
plane_surface = PlaneSurface(Plane=PlaneXY(0, 0, 0), XSize=multiplication, YSize=multiplication_2)
divide_domain² = DivideDomain²(Domain=plane_surface, UCount=x_cells, VCount=y_cells)
dom_2 = ConstructDomain(DomainStart=0.575, DomainEnd=0.5751)
isotrim = Isotrim(Surface=plane_surface, Domain=divide_domain²)
construct_domain = ConstructDomain(DomainStart=Slider(0.2, range=0..1), DomainEnd=Slider(0.85, range=0..1))
deconstruct_brep = DeconstructBrep(Brep=isotrim)  # -> Faces, Edges, Vertices
arrow_extension = Slider(0.734, range=0..1)
area = Area(Geometry=deconstruct_brep.Faces)  # -> Area, Centroid
deconstruct = Deconstruct(Point=area.Centroid)  # -> flatten(XComponent), flatten(YComponent), ZComponent
bounds = Bounds(Numbers=deconstruct.YComponent)
bounds_2 = Bounds(Numbers=deconstruct.XComponent)
remap_numbers = RemapNumbers(Value=deconstruct.YComponent, Source=bounds, Target=dom)  # -> Mapped, Clipped
remap_numbers_2 = RemapNumbers(Value=deconstruct.XComponent, Source=bounds_2, Target=dom)  # -> Mapped, Clipped
expression = Expression(x=remap_numbers_2.Clipped, y=remap_numbers.Clipped, Expression="abs(sin(2*π*x)*sin(2*π*y))")
bounds_3 = Bounds(Numbers=expression)
remap_numbers_3 = RemapNumbers(Value=expression, Source=bounds_3, Target=construct_domain)  # -> Mapped, graft(Clipped)
dispatch = Dispatch(List=isotrim, DispatchPattern=[True, False])  # -> ListA, ListB
lng = ListLength(List=flatten(deconstruct_brep.Vertices))
subtraction = Subtraction(A=lng, B=2)
dispatch_2 = Dispatch(List=remap_numbers_3.Mapped, DispatchPattern=[True, False])  # -> ListA, ListB
item = ListItem(List=flatten(deconstruct_brep.Vertices), Index=0, Wrap=True)
item_2 = ListItem(List=flatten(deconstruct_brep.Vertices), Index=subtraction, Wrap=True)
flip = FlipMatrix(Data=graft(dispatch.ListA))
multiplication_3 = Multiplication(A=dispatch_2.ListA, B=cell_size, C=0.5)  # -> graft(Result)
multiplication_4 = Multiplication(A=dispatch_2.ListB, B=cell_size, C=0.5)  # -> graft(Result)
debrep = DeconstructBrep(Brep=flip)  # -> Faces, Edges, Vertices
rec_2pt = Rectangle2Pt(Plane=PlaneXY(0, 0, 0), PointA=item_2, PointB=item, Radius=0)  # -> Rectangle, Length
multiplication_5 = Multiplication(A=remap_numbers_3.Mapped, B=cell_size, C=0.5)
multiplication_6 = Multiplication(A=multiplication_3, B=-1)
dispatch_3 = Dispatch(List=debrep.Edges, DispatchPattern=[True, False])  # -> ListA, ListB
multiplication_7 = Multiplication(A=multiplication_4, B=-1)
area_2 = Area(Geometry=debrep.Faces)  # -> Area, Centroid
debrep_2 = DeconstructBrep(Brep=dispatch.ListB)  # -> Faces, Edges, Vertices
curvepoint = PointOnCurve(dispatch_3.ListA, parameter=0.5)
curvepoint_2 = PointOnCurve(dispatch_3.ListB, parameter=0.5)
dispatch_4 = Dispatch(List=debrep_2.Edges, DispatchPattern=[True, False])  # -> ListA, ListB
area_3 = Area(Geometry=debrep_2.Faces)  # -> Area, Centroid
isoncurve = CSharpScript(x=rec_2pt.Rectangle, y=curvepoint_2)  # -> out, A; inputs x: Curve, y: Point3d
# ---------- isoncurve: C# ----------
    //We only use this method if there is a curve
    if(x != null)
    {
      //T is the paramenter on the curve
      double t;

      //A is assigned with true if closest point to y is within model tolerance,
      //otherwise it will be assigned false, and t will not be calculated
      A = x.ClosestPoint(y, out t, RhinoDoc.ActiveDoc.ModelAbsoluteTolerance);
    }
# ---------- end isoncurve ----------
isoncurve_2 = CSharpScript(x=rec_2pt.Rectangle, y=curvepoint)  # -> out, A; inputs x: Curve, y: Point3d; same code as isoncurve
curvepoint_3 = PointOnCurve(dispatch_4.ListB, parameter=0.5)
curvepoint_4 = PointOnCurve(dispatch_4.ListA, parameter=0.5)
cull = CullPattern(List=curvepoint_2, CullPattern=isoncurve.A)
cull_2 = CullPattern(List=curvepoint, CullPattern=isoncurve_2.A)
moveaway = MoveAwayFrom(Geometry=curvepoint_4, Emitter=area_3.Centroid, Distance=multiplication_7)  # -> Geometry, Transform
moveaway_2 = MoveAwayFrom(Geometry=curvepoint_3, Emitter=area_3.Centroid, Distance=multiplication_4)  # -> Geometry, Transform
cp = ClosestPoint(Point=cull, Cloud=flatten(area.Centroid))  # -> ClosestPoint, CPIndex, Distance
cp_2 = ClosestPoint(Point=cull_2, Cloud=flatten(area.Centroid))  # -> ClosestPoint, CPIndex, Distance
pt = Point(cull)
pt_2 = Point(cull_2)
weave = Weave(Pattern=[1, 2, 1, 0], Stream0=moveaway_2.Geometry, Stream1=debrep_2.Vertices, Stream2=moveaway.Geometry, NullGaps=False)
item_3 = ListItem(List=multiplication_5, Index=cp_2.CPIndex, Wrap=True)
item_4 = ListItem(List=multiplication_5, Index=cp.CPIndex, Wrap=True)
multiplication_8 = Multiplication(A=item_4, B=-1)
moveaway_3 = MoveAwayFrom(Geometry=pt_2, Emitter=cp_2.ClosestPoint, Distance=item_3)  # -> Geometry, Transform
isoncurve_3 = CSharpScript(x=rec_2pt.Rectangle, y=deconstruct_brep.Vertices)  # -> out, A; inputs x: Curve, y: Point3d; same code as isoncurve
moveaway_4 = MoveAwayFrom(Geometry=pt, Emitter=cp.ClosestPoint, Distance=multiplication_8)  # -> Geometry, Transform
pline = PolyLine(Vertices=weave, Closed=True)
cull_3 = CullPattern(List=deconstruct_brep.Vertices, CullPattern=isoncurve_3.A)  # -> flatten(List)
cullpt = CullDuplicates(Points=cull_3, Tolerance=0.1, CullMode=3)  # -> Points, Indices, Valence
cps = ClosestPoints(Point=moveaway_4.Geometry, Cloud=cullpt.Points, Count=2)  # -> ClosestPoint, CPIndex, Distance
cps_2 = ClosestPoints(Point=moveaway_3.Geometry, Cloud=cullpt.Points, Count=2)  # -> ClosestPoint, CPIndex, Distance
weave_2 = Weave(Pattern=[0, 1, 0], Stream0=cps.ClosestPoint, Stream1=moveaway_4.Geometry, NullGaps=False)
weave_3 = Weave(Pattern=[0, 1, 0], Stream0=cps_2.ClosestPoint, Stream1=moveaway_3.Geometry, NullGaps=False)
clean = CleanTree(RemoveNulls=True, RemoveInvalid=True, RemoveEmpty=True, Tree=weave_2)
clean_2 = CleanTree(RemoveNulls=True, RemoveInvalid=True, RemoveEmpty=True, Tree=weave_3)
pline_2 = PolyLine(Vertices=clean, Closed=False)
pline_3 = PolyLine(Vertices=clean_2, Closed=False)
group = Group(Objects=flatten([pline_3, pline_2, pline]))
bbox = BoundingBox(Content=simplify(flatten(group)), Plane=PlaneXY(0, 0, 0))  # -> Box, Box_2; disabled
polyoffset = PolylineOffset(
    Polylines=flatten([pline_3, pline_2, pline]),
    Distance=Slider(0.23, range=0..1),
    Plane=Plane(origin=(0, 0, 0), x=(0, 0, 0), y=(0, 0, 0)),
    Tolerance=0.001,
    ClosedFillet=1,
    OpenFillet=1,
    Miter=2)  # -> Contour, Holes
num = Number(8)
box_corners = BoxCorners(Box=bbox.Box)  # -> CornerA, CornerB, CornerC, CornerD, CornerE, CornerF, CornerG, CornerH
moveaway_5 = MoveAwayFrom(Geometry=box_corners.CornerA, Emitter=box_corners.CornerD, Distance=num)  # -> Geometry, Transform
moveaway_6 = MoveAwayFrom(Geometry=box_corners.CornerC, Emitter=box_corners.CornerF, Distance=num)  # -> Geometry, Transform
num_2 = Number(15)
rec_3pt = Rectangle3Pt(PointA=box_corners.CornerC, PointB=box_corners.CornerD, PointC=moveaway_6.Geometry)  # -> flatten(Rectangle), Length
rec_3pt_2 = Rectangle3Pt(PointA=box_corners.CornerA, PointB=box_corners.CornerB, PointC=moveaway_5.Geometry)  # -> flatten(Rectangle), Length
area_4 = Area(Geometry=rec_3pt_2.Rectangle)  # -> Area, Centroid
area_5 = Area(Geometry=rec_3pt.Rectangle)  # -> Area, Centroid
num_3 = Number(5)
moveaway_7 = MoveAwayFrom(Geometry=area_4.Centroid, Emitter=bbox.Box, Distance=num_2)  # -> Geometry, Transform
moveaway_8 = MoveAwayFrom(Geometry=area_5.Centroid, Emitter=bbox.Box, Distance=num_2)  # -> Geometry, Transform
ln = Line(StartPoint=area_4.Centroid, EndPoint=moveaway_7.Geometry)
ln_2 = Line(StartPoint=area_5.Centroid, EndPoint=moveaway_8.Geometry)
polyoffset_2 = PolylineOffset(
    Polylines=ln,
    Distance=num_3,
    Plane=Plane(origin=(0, 0, 0), x=(0, 0, 0), y=(0, 0, 0)),
    Tolerance=0.001,
    ClosedFillet=0,
    OpenFillet=2,
    Miter=2)  # -> Contour, Holes
polyoffset_3 = PolylineOffset(
    Polylines=ln_2,
    Distance=num_3,
    Plane=Plane(origin=(0, 0, 0), x=(0, 0, 0), y=(0, 0, 0)),
    Tolerance=0.001,
    ClosedFillet=0,
    OpenFillet=2,
    Miter=2)  # -> Contour, Holes
runion = RegionUnion(Curves=flatten([polyoffset_3.Contour, rec_3pt.Rectangle]))
runion_2 = RegionUnion(Curves=flatten([polyoffset_2.Contour, rec_3pt_2.Rectangle]))
vector_xyz = VectorXYZ(XComponent=Slider(0, range=0..10), YComponent=Slider(0, range=0..10), ZComponent=Slider(5, range=0..10))  # -> Vector, Length
runion_3 = RegionUnion(Curves=[runion_2, runion, polyoffset.Contour])
curvepoint_5 = PointOnCurve(ln_2, parameter=0.667)
num_4 = Number(2)
curvepoint_6 = PointOnCurve(ln, parameter=0.667)
circle = CircleCNR(Center=curvepoint_6, Normal=Vector(0, 0, 1), Radius=num_4)
circle_2 = CircleCNR(Center=curvepoint_5, Normal=Vector(0, 0, 1), Radius=num_4)
rdiff = RegionDifference(CurvesA=flatten([circle, runion_3, circle_2]), CurvesB=polyoffset.Holes)
boundary_surfaces = BoundarySurfaces(Edges=flatten(rdiff))
extrude = Extrude(Base=flatten(boundary_surfaces), Direction=vector_xyz.Vector)
