# Grasshopper definition parametric_stars.gh (Grasshopper 1.0.7)
# plug-ins: ClipperComponents

y_cells = Slider(6, range=0..30)
cell_size = Slider(15, range=5..30)
x_cells = Slider(4, range=0..30)
multiplication = Multiplication(A=cell_size, B=y_cells)
multiplication_2 = Multiplication(A=cell_size, B=x_cells)
plane_surface = PlaneSurface(Plane=PlaneXY(0, 0, 0), XSize=multiplication_2, YSize=multiplication)
divide_domain² = DivideDomain²(Domain=plane_surface, UCount=x_cells, VCount=y_cells)
isotrim = Isotrim(Surface=plane_surface, Domain=divide_domain²)
dom = ConstructDomain(DomainStart=0, DomainEnd=1)
deconstruct_brep = DeconstructBrep(Brep=isotrim)  # -> Faces, Edges, Vertices
area = Area(Geometry=deconstruct_brep.Faces)  # -> Area, Centroid
deconstruct = Deconstruct(Point=area.Centroid)  # -> flatten(XComponent), flatten(YComponent), ZComponent
bounds = Bounds(Numbers=deconstruct.YComponent)
bounds_2 = Bounds(Numbers=deconstruct.XComponent)
remap_numbers = RemapNumbers(Value=deconstruct.YComponent, Source=bounds, Target=dom)  # -> Mapped, Clipped
remap_numbers_2 = RemapNumbers(Value=deconstruct.XComponent, Source=bounds_2, Target=dom)  # -> Mapped, Clipped
point_on_curve = PointOnCurve(deconstruct_brep.Edges, parameter=0.5)
line = Line(StartPoint=deconstruct_brep.Vertices, EndPoint=area.Centroid)
expression = Expression(x=remap_numbers_2.Clipped, y=remap_numbers.Clipped, Expression="abs(sin(2*pi*y))")
num = Number(0.3375)
construct_domain = ConstructDomain(DomainStart=Slider(0.45, range=0..0.5), DomainEnd=Slider(0.225, range=0..0.5))
num_2 = Number(0.3376)
line_2 = Line(StartPoint=area.Centroid, EndPoint=point_on_curve)
evaluate_curve = EvaluateCurve(Curve=reparameterize(line), Parameter=Slider(0.129, range=0..0.5))  # -> Point, Tangent, Angle
bounds_3 = Bounds(Numbers=expression)
dom_2 = ConstructDomain(DomainStart=num, DomainEnd=num_2)
remap_numbers_3 = RemapNumbers(Value=expression, Source=bounds_3, Target=construct_domain)  # -> Mapped, graft(Clipped)
point = Point(evaluate_curve.Point)
evaluate_curve_2 = EvaluateCurve(Curve=reparameterize(line_2), Parameter=remap_numbers_3.Clipped)  # -> Point, Tangent, Angle
weave = Weave(Pattern=[0, 1], Stream0=point, Stream1=evaluate_curve_2.Point, NullGaps=False)
line_3 = Line(StartPoint=evaluate_curve_2.Point, EndPoint=point_on_curve)
polyline = PolyLine(Vertices=weave, Closed=True)
group = Group(Objects=flatten([polyline, line_3]))
bbox = BoundingBox(Content=simplify(flatten(group)), Plane=PlaneXY(0, 0, 0))  # -> Box, Box_2; disabled
num_3 = Number(8)
box_corners = BoxCorners(Box=bbox.Box)  # -> CornerA, CornerB, CornerC, CornerD, CornerE, CornerF, CornerG, CornerH
boolean_toggle = BooleanToggle(False)
moveaway = MoveAwayFrom(Geometry=box_corners.CornerA, Emitter=box_corners.CornerD, Distance=num_3)  # -> Geometry, Transform
moveaway_2 = MoveAwayFrom(Geometry=box_corners.CornerC, Emitter=box_corners.CornerF, Distance=num_3)  # -> Geometry, Transform
num_4 = Number(15)
rec_3pt = Rectangle3Pt(PointA=box_corners.CornerC, PointB=box_corners.CornerD, PointC=moveaway_2.Geometry)  # -> flatten(Rectangle), Length
rec_3pt_2 = Rectangle3Pt(PointA=box_corners.CornerA, PointB=box_corners.CornerB, PointC=moveaway.Geometry)  # -> flatten(Rectangle), Length
area_2 = Area(Geometry=rec_3pt_2.Rectangle)  # -> Area, Centroid
area_3 = Area(Geometry=rec_3pt.Rectangle)  # -> Area, Centroid
num_5 = Number(5)
moveaway_3 = MoveAwayFrom(Geometry=area_2.Centroid, Emitter=bbox.Box, Distance=num_4)  # -> Geometry, Transform
moveaway_4 = MoveAwayFrom(Geometry=area_3.Centroid, Emitter=bbox.Box, Distance=num_4)  # -> Geometry, Transform
polyline_offset = PolylineOffset(
    Polylines=flatten([polyline, line_3]),
    Distance=Slider(0.23, range=0..1),
    Plane=Plane(origin=(0, 0, 0), x=(0, 0, 0), y=(0, 0, 0)),
    Tolerance=0.001,
    ClosedFillet=1,
    OpenFillet=1,
    Miter=2)  # -> flatten(Contour), Holes
ln = Line(StartPoint=area_2.Centroid, EndPoint=moveaway_3.Geometry)
ln_2 = Line(StartPoint=area_3.Centroid, EndPoint=moveaway_4.Geometry)
polyoffset = PolylineOffset(
    Polylines=ln,
    Distance=num_5,
    Plane=Plane(origin=(0, 0, 0), x=(0, 0, 0), y=(0, 0, 0)),
    Tolerance=0.001,
    ClosedFillet=0,
    OpenFillet=2,
    Miter=2)  # -> Contour, Holes
polyoffset_2 = PolylineOffset(
    Polylines=ln_2,
    Distance=num_5,
    Plane=Plane(origin=(0, 0, 0), x=(0, 0, 0), y=(0, 0, 0)),
    Tolerance=0.001,
    ClosedFillet=0,
    OpenFillet=2,
    Miter=2)  # -> Contour, Holes
runion = RegionUnion(Curves=flatten([polyoffset_2.Contour, rec_3pt.Rectangle]))
runion_2 = RegionUnion(Curves=flatten([polyoffset.Contour, rec_3pt_2.Rectangle]))
curve = Curve([polyline_offset.Contour, polyline_offset.Holes])
vector_xyz = VectorXYZ(XComponent=Slider(0, range=0..10), YComponent=Slider(0, range=0..10), ZComponent=Slider(5, range=0..10))  # -> Vector, Length
curvepoint = PointOnCurve(ln_2, parameter=0.667)
num_6 = Number(2)
runion_3 = RegionUnion(Curves=flatten([runion_2, runion, polyline_offset.Contour]))
curvepoint_2 = PointOnCurve(ln, parameter=0.667)
circle = CircleCNR(Center=curvepoint_2, Normal=Vector(0, 0, 1), Radius=num_6)
circle_2 = CircleCNR(Center=curvepoint, Normal=Vector(0, 0, 1), Radius=num_6)
rdiff = RegionDifference(CurvesA=flatten([runion_3, circle, circle_2]), CurvesB=polyline_offset.Holes)
boundary_surfaces = BoundarySurfaces(Edges=flatten(rdiff))
extrude = Extrude(Base=flatten(boundary_surfaces), Direction=vector_xyz.Vector)
